# Grasshopper definition Animation Controller.ghx (Grasshopper 1.0.5)

# ----
# Animation Controller: This definition is to control the creation of animations from GH.
# 
# Inputs:
# 
# ToggleRun [boolean toggle] - Setting this to 'True' will automatically advanced the animation and slider until the slider reaches the maximum. Once it reaches the maximum, it will reset the slider and itself. Frames will only be saved when this is set to 'True'.
# 
# Timeline [slider] - Use the slider to scrobble through the animation when 'ToggleRun' is set to 'False'. When ToggleRun is set to 'True', this slider will auto-increment until it reaches its max. This slider's upper limit/maximum corresponds to the number of frames.
# 
# Path [panel] - The directory where the frames will be saved.
# 
# FrameName [panel] - The frame file name prefix.
# 
# Outputs: use these to drive animation elements.
# 
# TotalFrames [int] - the total number  of frames. This correspondds to the 'Timeline' slider's range. Change the 'Timeline' Minimim and Maxmimim to affect this.
# 
# CurrentFrame [int] - The current frame.
timeline = Slider(0, range=0..100)
path = Panel("C:\data\animation1")
togglerun = BooleanToggle(False)
framename = Panel("animTest")

# ---- group: Camera Path
crv = Curve(reparameterize(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))

# ---- group: Camera Target
pt = Point(Point(37.24201868, 38.6968505, 25.92228352))

# ----
c_script = CSharpScript(run=togglerun, currentFrame=timeline, path=path, frameName=framename)  # -> out, TotalFrames, CurrentFrame; inputs run: Boolean, currentFrame: Int32, path: String, frameName: String
# ---------- c_script: C# ----------
    slider = GrasshopperDocument.Objects.Where(o => o.NickName == "Timeline").First() as Grasshopper.Kernel.Special.GH_NumberSlider;
    toggle = GrasshopperDocument.Objects.Where(o => o.NickName == "ToggleRun").First() as Grasshopper.Kernel.Special.GH_BooleanToggle;
    totalFrames = (int) slider.Slider.Maximum - (int) slider.Slider.Minimum;
    TotalFrames = totalFrames;
    CurrentFrame = currentFrame;

    if(currentFrame == (int) slider.Slider.Maximum && run )
    {
      toggle.Value = false;
      running = false;
      slider.TrySetSliderValue(frameAtStart);
      cnt = frameAtStart;
      toggle.ExpireSolution(true);
      return;
    }

    //Component.Message = (int) slider.Slider.Value + "/" + TotalFrames + " Frames";
    Component.Message = "";

    if(run)
    {

      //init
      if(!running)
      {
        frameAtStart = currentFrame;
        cnt = frameAtStart;
        running = true;
      }

      //do image saving
      var view = RhinoDocument.Views.ActiveView;
      var capture = new Rhino.Display.ViewCapture
        {
          Width = view.ActiveViewport.Size.Width,
          Height = view.ActiveViewport.Size.Height,
          ScaleScreenItems = false,
          DrawAxes = false,
          DrawGrid = false,
          DrawGridAxes = false,
          TransparentBackground = false
          };


      var bitmap = capture.CaptureToBitmap(view);

      if (null != bitmap)
      {
        if(!Directory.Exists(path))
          Print("{0}", Directory.CreateDirectory(path));

        var filename = Path.Combine(path, frameName + "_" + currentFrame + ".png");
        bitmap.Save(filename, System.Drawing.Imaging.ImageFormat.Png);
      }

      //auto increment slider
      slider.TrySetSliderValue(cnt++);
      CurrentFrame = cnt;

      toggle.ExpireSolution(true);

    }
# ---------- c_script: C# additional code ----------
  int totalFrames = 0;
  int frameAtStart = 0;
  bool running = false;
  int cnt = 0;

  Grasshopper.Kernel.Special.GH_NumberSlider slider = new Grasshopper.Kernel.Special.GH_NumberSlider();
  Grasshopper.Kernel.Special.GH_BooleanToggle toggle = new Grasshopper.Kernel.Special.GH_BooleanToggle();
# ---------- end c_script ----------
panel = Panel([c_script.TotalFrames, c_script.CurrentFrame])

# ---- group: Step
division = Division(A="1", B=c_script.TotalFrames)
multiplication = Multiplication(A=c_script.CurrentFrame, B=division)

# ----
eval = EvaluateCurve(Curve=crv, Parameter=multiplication)  # -> Point, Tangent, Angle

# ---- group: Position Camera
c_script_2 = CSharpScript(camPosition=eval.Point, camTarget=pt)  # -> out, A; inputs camPosition: Point3d, camTarget: Point3d
# ---------- c_script_2: C# ----------
    RhinoDocument.Views.ActiveView.ActiveViewport.SetCameraLocations(camTarget, camPosition);
# ---------- end c_script_2 ----------
